# Grasshopper definition Outdoor_Airflow_Sim.gh (Grasshopper 1.0.7)
# plug-ins: ElkGHComponents

# ----
# Ladybug - Wind Analysis
panel = Panel("https://energyplus-weather.s3.amazonaws.com/asia_wmo_region_2/CHN/CHN_Hong.Kong.SAR.450070_CityUHK/CHN_Hong.Kong.SAR.450070_CityUHK.zip")
ladybug = Ladybug_Ladybug()  # -> Vviiiiiiiiiizzz; plug-in component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
path = FilePath("D:\RLinGUD\ARCH402_TA\")
downloadepw = LBDownloadWeather(weather_URL=panel, folder=path)  # -> epw_file, stat_file, ddy_file; plug-in component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
panel_2 = Panel(ladybug)
panel_3 = Panel(downloadepw.epw_file)
importepw = LBImportEPW(epw_file=panel_3)  # -> location, dry_bulb_temperature, dew_point_temperature, relative_humidity, wind_speed, wind_direction, direct_normal_rad, diffuse_horizontal_rad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; plug-in component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
analysisperiod = LBAnalysisPeriod(
    start_month=Slider(1, range=1..12),
    start_day=Slider(1, range=1..31),
    start_hour=Slider(0, range=0..24),
    end_month=Slider(12, range=1..12),
    end_day=Slider(31, range=1..31),
    end_hour=Slider(23, range=0..24))  # -> period, hoys, dates; plug-in component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
number_slider = Slider(1, range=0..10)
pt = Point(Point(562.5746992, -387.6635662, 0))
Y = UnitY(Factor=1)
windrose = LBWindRose(
    north=Y,
    data=importepw.wind_speed,
    wind_direction=importepw.wind_direction,
    center_pt=pt,
    show_calmrose=Toggle(True),
    show_freq=Toggle(True),
    period=analysisperiod.period)  # -> report, mesh, compass, orient_line, freq_line, windrose_line, legend, title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; plug-in component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

# ---- group: Open weather database map
epwmap = LBEPWmap(epw_map=Toggle(False))  # -> report; plug-in component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

# ----
wall = Butterfly_WallBoundary()  # -> wall_boundary; plug-in component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

# ----
# Butterfly - Wind Tunnel Simulation
butterfly = Butterfly()  # -> swooooosh; "BF::BF"; plug-in component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
brep = Brep([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])
mesh = MeshBrep(
    Brep=brep,
    Settings={GridMaxCount=0, GridMinCount=16, JaggedSeams=False, MaxEdgeLength=0, MinEdgeLength=0.0001, MinTolerance=0, Refine=True, RefineAngle=0, RelativeTolerance=0.65, SimplePlanes=True, Tolerance=0})
preview = CustomPreview(Geometry=brep, Material=ColourSwatch(SwatchColor=RGB(183, 216, 68)))
panel_4 = Panel(butterfly)
createbfgeometry = Butterfly_CreateButterflyGeometry(name="bldg_context", geo=flatten(mesh), boundary=wall)  # -> report, BF_geo; plug-in component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

# ---- group: case
X = UnitX(Factor=-1)
windvector = Butterfly_WindVector(wind_speed=Slider(10, range=0..10), wind_direction=X)  # -> wind_vector; plug-in component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
createcasefromtunnel = Butterfly_CreateCaseFromTunnel(
    name="windtunnel_case",
    BF_geo=flatten(createbfgeometry.BF_geo),
    wind_vector=windvector,
    ref_wind_height=10,
    landscape=Slider(7, range=0..7),
    run=Toggle(True))  # -> report, block_pts, wind_tunnel, case; plug-in component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

# ---- group: blockmesh
number_slider_2 = Slider(50, range=0..1000)
wtgrading = Butterfly_windTunnelGrading(
    wind_tunnel=createcasefromtunnel.wind_tunnel,
    cell_size=number_slider_2,
    cell_to_cell_ratio=1.2,
    wake_offset=2,
    height_offset=5)  # -> report, grad_xyz, cell_count_xyz, cell_count_tot, preview; plug-in component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
blockmesh = Butterfly_blockMesh(
    case=createcasefromtunnel.case,
    grad_xyz=wtgrading.grad_xyz,
    cell_count=wtgrading.cell_count_xyz,
    overwrite=True,
    write=Toggle(True),
    run=Toggle(False))  # -> report, case; plug-in component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
loadmesh = Butterfly_LoadMesh(case=blockmesh.case, inner_mesh=False, load=Toggle(False))  # -> mesh; plug-in component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

# ---- group: hex mesh
snappyhexmesh = Butterfly_snappyHexMesh(case=blockmesh.case, glob_refine_level="2,2", write=Toggle(True), run=Toggle(False))  # -> report, case; plug-in component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
loadmesh_2 = Butterfly_LoadMesh(case=snappyhexmesh.case, inner_mesh=False, load=Toggle(False))  # -> mesh; plug-in component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

# ----
# SITE
# MODEL
path_2 = FilePath("D:\RLinGUD\ARCH402_TA\hongkong-osm.osm")
loc = Location(FilePathText=path_2)  # -> OSMPointData, OSMFile, LongitudeDomain, LatitudeDomain
osm = OSMData(OSMPointData=loc.OSMPointData, OSMFilePath=loc.OSMFile, Feature="building", Generate3d=True, IndividualOutputs=False)  # -> Ways, Buildings, FeatureKey
osm_2 = OSMData(OSMPointData=loc.OSMPointData, OSMFilePath=loc.OSMFile, Feature="highway", Generate3d=False, IndividualOutputs=False)  # -> Ways, FeatureKey
osm_3 = OSMData(OSMPointData=loc.OSMPointData, OSMFilePath=loc.OSMFile, Feature="waterway", Generate3d=False, IndividualOutputs=False)  # -> Ways, FeatureKey
osm_4 = OSMData(OSMPointData=loc.OSMPointData, OSMFilePath=loc.OSMFile, Feature="railway", Generate3d=False, IndividualOutputs=False)  # -> Ways, FeatureKey
osm_5 = OSMData(OSMPointData=loc.OSMPointData, OSMFilePath=loc.OSMFile, Feature="route", Generate3d=False, IndividualOutputs=False)  # -> Ways, FeatureKey
osm_6 = OSMData(
    OSMPointData=loc.OSMPointData,
    OSMFilePath=loc.OSMFile,
    Feature="natural",
    Generate3d=False,
    IndividualOutputs=False,
    SelectedTypes=["arete", "bare_rock", "bay", "beach", "cave_entrance", "cliff", "fell", "glacier", "grassland", "heath", "moor", "mud", "peak", "ridge", "river_terrace", "rock", "saddle", "sand", "scree", "scrub", "shingle", "sinkhole", "spring", "stone", "tree", "tree_row", "valley", "volcano", "water", "wetland", "wood"])  # -> Ways, FeatureKey
osm_7 = OSMData(OSMPointData=loc.OSMPointData, OSMFilePath=loc.OSMFile, Feature="amenity", Generate3d=False, IndividualOutputs=False)  # -> Ways, FeatureKey
osm_8 = OSMData(OSMPointData=loc.OSMPointData, OSMFilePath=loc.OSMFile, Feature="sport", Generate3d=False, IndividualOutputs=False)  # -> Ways, FeatureKey
osm_9 = OSMData(OSMPointData=loc.OSMPointData, OSMFilePath=loc.OSMFile, Feature="landuse", Generate3d=False, IndividualOutputs=False)  # -> Ways, FeatureKey
intcrv = Interpolate(Vertices=osm_2.Ways, Degree=3, Periodic=False, KnotStyle=1)  # -> Curve, Length, Domain
intcrv_2 = Interpolate(Vertices=osm_5.Ways, Degree=3, Periodic=False, KnotStyle=1)  # -> Curve, Length, Domain
intcrv_3 = Interpolate(Vertices=osm_3.Ways, Degree=3, Periodic=False, KnotStyle=1)  # -> Curve, Length, Domain
pline = PolyLine(Vertices=osm_7.Ways, Closed=True)
intcrv_4 = Interpolate(Vertices=osm_4.Ways, Degree=3, Periodic=False, KnotStyle=1)  # -> Curve, Length, Domain
intcrv_5 = Interpolate(Vertices=osm_6.Ways, Degree=3, Periodic=False, KnotStyle=1)  # -> Curve, Length, Domain
pline_2 = PolyLine(Vertices=osm_8.Ways, Closed=True)
pline_3 = PolyLine(Vertices=osm_9.Ways, Closed=True)
brep_2 = Brep(osm.Buildings)
cls = Closed(Curve=intcrv_5.Curve)  # -> Closed, Periodic
cull = CullPattern(List=flatten(intcrv_5.Curve), CullPattern=flatten(cls.Closed))
number_slider_3 = Slider(5, range=0..10)

# ----
# Topo
path_3 = FilePath("D:\RLinGUD\ARCH402_TA\N22E114.hgt")
stopo = SRTMTopo(Path=path_3, Latitude=loc.LatitudeDomain, Longitude=loc.LongitudeDomain)  # -> Points, Curves, Surface
srf = Surface(stopo.Surface)
Z = UnitZ(Factor=20)
Z_2 = UnitZ(Factor=-50)
move = Move(Geometry=srf, Motion=Z)  # -> Geometry, Transform
crv = Curve(move.Geometry)
project = Project(Geometry=crv, Plane=PlaneXY(0, 0, 0))  # -> Geometry, Transform
move_2 = Move(Geometry=project.Geometry, Motion=Z_2)  # -> Geometry, Transform
contour = Contour(Shape=move.Geometry, Point=Point(0, 0, 0), Direction=Vector(0, 0, 1), Distance=Slider(2, range=0..10))
srf_2 = Surface(move_2.Geometry)
loft = Loft(
    Curves=[crv, move_2.Geometry],
    Options={Adjust=False, Closed=False, LoftEnds=0, LoftSimp=0, LoftType=0, Rebuild=10, Refit=0.01})
preview_2 = CustomPreview(Geometry=contour, Material=ColourSwatch(SwatchColor=RGBA(0, 0, 0, 138)))
sea_wall_height = Slider(5, range=0..10)
Z_3 = UnitZ(Factor=expr("-x", sea_wall_height))

# ---- group: Simul. Srf
srf_3 = Surface(move.Geometry)
crv_2 = Curve(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)
Z_4 = UnitZ(Factor=-100)
move_3 = Move(Geometry=crv_2, Motion=Z_4)  # -> Geometry, Transform
Z_5 = UnitZ(Factor=300)
move_4 = Move(Geometry=move_3.Geometry, Motion=Z_5)  # -> Geometry, Transform
loft_2 = Loft(
    Curves=[move_4.Geometry, move_3.Geometry],
    Options={Adjust=False, Closed=False, LoftEnds=0, LoftSimp=0, LoftType=0, Rebuild=10, Refit=0.01})
split = SplitBrep(Brep=srf_3, Cutter=loft_2)
srf_4 = Surface(move_3.Geometry)
split_2 = SplitList(List=split, Index=1)  # -> ListA, ListB
srf_5 = Surface(split_2.ListB)

# ---- group: grid pts
number_slider_4 = Slider(50, range=0..100)
genpts = LBGeneratePointGrid(geometry=srf_4, grid_size=number_slider_2)  # -> points, vectors, face_areas, graft(mesh); plug-in component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
Z_6 = UnitZ(Factor=1)
project_2 = ProjectPoint(Point=genpts.points, Direction=Z_6, Geometry=srf_5)  # -> Point, Index

# ---- group: solver
max_iteration = Slider(2000, range=0..5000)
controldict = Butterfly_controlDict(start_time=0, end_time=max_iteration, write_interval=100, write_compression=False, purge_write=0)  # -> control_dict; plug-in component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
pt_2 = Point(project_2.Point)
probes = Butterfly_probes(points=pt_2, fields="U")  # -> probes; plug-in component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
ras = Butterfly_RASTurbulenceModel(RAS_model="RNGkEpsilon", turbulence=True, print_coeffs=True)  # -> RAS; plug-in component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
solutionparams = Butterfly_SolutionParameters(control_dict=controldict, probes=probes)  # -> solution_par; plug-in component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
steadyincomp = Butterfly_SteadyIncompressibleRecipe()  # -> report, recipe; plug-in component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
solution = Butterfly_Solution(
    case=snappyhexmesh.case,
    recipe=steadyincomp.recipe,
    solution_par=solutionparams,
    interval=2,
    write=Toggle(True),
    run=Toggle(False))  # -> report, solution, is_running, timestep, residual_fields, residual_values, log_files; plug-in component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
loadprobesvalue = Butterfly_LoadProbesValue(solution=solution.solution, field="U")  # -> values; plug-in component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

# ---- group: visual
pt_3 = Point(project_2.Point)
vec = Vector(loadprobesvalue)
vlen = VectorLength(Vector=vec)
sort = SortList(Keys=vlen)  # -> Keys, ValuesA
panel_5 = Panel(sort.Keys)
bnd = Bounds(Numbers=vlen)
number_slider_5 = Slider(100, range=0..10000)
vec_2 = Vector(unitize(vec))
dedomain = DeconstructDomain(Domain=bnd)  # -> Start, End
colrange = LBColorRange(index=Slider(0, range=0..25))  # -> colors; plug-in component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
multiplication = Multiplication(A=vec_2, B=Slider(40, range=0..100))
legendpar = LBLegendParameters(
    min=0,
    max="7",
    colors=colrange,
    vert_or_horiz=Toggle(False),
    seg_height=number_slider_5,
    seg_width=number_slider_5,
    text_height=Slider(15, range=0..100))  # -> leg_par; plug-in component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
gradient = Gradient(
    LowerLimit=dedomain.Start,
    UpperLimit="7",
    Parameter=vlen,
    stops=[0: RGB(75, 107, 169), 0.203: RGB(173, 203, 249), 0.5: RGB(254, 244, 84), 0.784: RGB(234, 126, 0), 1: RGB(234, 38, 0)])
legend_origin = Point(Point(3475.624255, -217.4272494, 0))
createlegend = LBCreateLegend(values=sort.Keys, base_plane=legend_origin, title="Hong Kong - Wind speed m/s", legend_par=legendpar)  # -> mesh, title_obj, label_objs, label_text, colors; plug-in component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
vdisex = VectorDisplayEx(Point=pt_3, Vector=multiplication, Colour=gradient, Width=Slider(2, range=0..10))

# ---- group: Building footprint
pline_4 = PolyLine(Vertices=osm.Ways, Closed=True)
area = Area(Geometry=pline_4)  # -> Area, Centroid
Z_7 = UnitZ(Factor=1)
project_3 = ProjectPoint(Point=area.Centroid, Direction=Z_7, Geometry=move.Geometry)  # -> Point, Index
ln = Line(StartPoint=flatten(area.Centroid), EndPoint=flatten(project_3.Point))
len = Length(Curve=ln)  # -> flatten(Length)
building_footprint = Surface(flatten(pline_4))
Z_8 = UnitZ(Factor=len)

# ---- group: Building masses
python = GhPythonScript(keys=osm.FeatureKey, max_levels=100, avg_floor_height=3)  # -> out, height_list; inputs keys: tree, max_levels: Int32
# ---------- python: Python ----------
__author__ = "heh"
__version__ = "2022.02.15"

import random
import ghpythonlib.components as ghcomp

keys_list = [list(i) for i in keys.Branches]


height_list = []

for list in keys_list:
    
    i = 1
    finds = []
    
    while i < max_levels:
        
        lookup_item = 'building:levels:{}'.format(i)
        found = ghcomp.KeyValueSearch(list, list, lookup_item)
        finds.append(found)
        
        if found != None:
            height_list.append(i*avg_floor_height)
            break
        i += 1
    
    if finds.count(None) == len(finds):
        height_list.append(int(random.uniform(2,10))*avg_floor_height)
# ---------- end python ----------
Z_9 = UnitZ(Factor=python.height_list)
extr = Extrude(Base=building_footprint, Direction=Z_9)

# ---- group: footprints
move_5 = Move(Geometry=building_footprint, Motion=Z_8)  # -> Geometry, Transform

# ---- group: Building footprint (continued)
move_6 = Move(Geometry=extr, Motion=Z_8)  # -> Geometry, Transform

# ----
project_4 = Project(Curve=pline, Brep=move.Geometry, Direction=Vector(0, 0, 1))
project_5 = Project(Curve=pline_2, Brep=move.Geometry, Direction=Vector(0, 0, 1))
project_6 = Project(Curve=intcrv_4.Curve, Brep=move.Geometry, Direction=Vector(0, 0, 1))
project_7 = Project(Curve=intcrv_2.Curve, Brep=move.Geometry, Direction=Vector(0, 0, 1))
project_8 = Project(Curve=intcrv.Curve, Brep=move.Geometry, Direction=Vector(0, 0, 1))
project_9 = Project(Curve=intcrv_3.Curve, Brep=move.Geometry, Direction=Vector(0, 0, 1))
project_10 = Project(Curve=pline_3, Brep=move.Geometry, Direction=Vector(0, 0, 1))
project_11 = Project(Curve=cull, Brep=move.Geometry, Direction=Vector(0, 0, 1))
preview_3 = CustomPreview(Geometry=project_8, Material=ColourSwatch(SwatchColor=RGB(0, 0, 0)))
preview_4 = CustomPreview(Geometry=project_9, Material=ColourSwatch(SwatchColor=RGB(0, 255, 255)))
preview_5 = CustomPreview(Geometry=project_6, Material=ColourSwatch(SwatchColor=RGB(222, 23, 134)))
preview_6 = CustomPreview(Geometry=project_7, Material=ColourSwatch(SwatchColor=RGB(17, 110, 134)))
preview_7 = CustomPreview(Geometry=project_11, Material=ColourSwatch(SwatchColor=RGB(59, 158, 80)))
preview_8 = CustomPreview(Geometry=project_4, Material=ColourSwatch(SwatchColor=RGBA(136, 109, 80, 68)))
preview_9 = CustomPreview(Geometry=project_5, Material=ColourSwatch(SwatchColor=RGBA(136, 109, 80, 86)))
preview_10 = CustomPreview(Geometry=project_10, Material=ColourSwatch(SwatchColor=RGB(38, 41, 235)))
preview_11 = CustomPreview(Geometry=move_6.Geometry, Material=ColourSwatch(SwatchColor=RGB(255, 255, 255)))

# ---- group: Coastline
osm_10 = OSMData(
    OSMPointData=loc.OSMPointData,
    OSMFilePath=loc.OSMFile,
    Feature="natural",
    Generate3d=False,
    IndividualOutputs=False,
    SelectedTypes="coastline")  # -> Ways, FeatureKey
pline_5 = PolyLine(Vertices=osm_10.Ways, Closed=False)
project_12 = Project(Curve=pline_5, Brep=move.Geometry, Direction=Vector(0, 0, 1))

# ----
srfsplit = SurfaceSplit(Surface=move.Geometry, Curves=flatten(project_12))
cull_i = CullIndex(List=srfsplit, Indices=number_slider_3, Wrap=True)
item = ListItem(List=srfsplit, Index=number_slider_3, Wrap=True)
extr_2 = Extrude(Base=project_12, Direction=Z_3)

move_7 = Move(Geometry=item, Motion=Z_3)  # -> Geometry, Transform
preview_12 = CustomPreview(Geometry=[cull_i, loft, srf_2], Material=ColourSwatch(SwatchColor=RGB(125, 124, 114)))

preview_13 = CustomPreview(Geometry=move_7.Geometry, Material=ColourSwatch(SwatchColor=RGBA(63, 89, 114, 212)))

# ---- group: Coastline (continued)
preview_14 = CustomPreview(Geometry=[extr_2, project_12], Material=ColourSwatch(SwatchColor=RGB(255, 255, 0)))
